% Simulink data dictionary Adaptive_Cruise_Control_DataDictionary.sldd

CameraInput_LeadVehicle = Simulink.Signal(StorageClass="ImportedExtern", DataType="uint8", Min=0, Max=255, SampleTime=0.01)
RadarInput_LeadVehicle = Simulink.Signal(StorageClass="ImportedExtern", DataType="uint8", Min=0, Max=255, SampleTime=0.01)
CameraInput_DriveVehicle = Simulink.Signal(StorageClass="ImportedExtern", DataType="uint8", Min=0, Max=255, SampleTime=0.01)
RadarInput_DriveVehicle = Simulink.Signal(StorageClass="ImportedExtern", DataType="uint8", Min=0, Max=255, SampleTime=0.01)
Time_Gap = Simulink.Signal(StorageClass="ImportedExtern", DataType="uint8", Min=0, Max=255, SampleTime=0.01)
Set_Speed = Simulink.Signal(StorageClass="ImportedExtern", DataType="uint8", Min=0, Max=255, SampleTime=0.01)
Set_Gap = Simulink.Signal(StorageClass="ImportedExtern", DataType="uint8", Min=0, Max=255, SampleTime=0.01)
CruiseSwitch = Simulink.Signal(StorageClass="ImportedExtern", DataType="boolean", Min=0, Max=1, SampleTime=0.01)
SetSwitch = Simulink.Signal(StorageClass="ImportedExtern", DataType="boolean", Min=0, Max=1, SampleTime=0.01)
LeadVehicle_Speed = Simulink.Signal(StorageClass="ExportToFile", HeaderFile="Adaptive_Cruise_Control.h", DefinitionFile="Adaptive_Cruise_Control.c", DataType="uint8", Min=0, Max=255, SampleTime=0.01)
DriveVehicle_Speed = Simulink.Signal(StorageClass="ExportToFile", HeaderFile="Adaptive_Cruise_Control.h", DefinitionFile="Adaptive_Cruise_Control.c", DataType="uint8", Min=0, Max=255, SampleTime=0.01)
LeadVehicle_Detected = Simulink.Signal(StorageClass="ExportToFile", HeaderFile="Adaptive_Cruise_Control.h", DefinitionFile="Adaptive_Cruise_Control.c", DataType="uint8", Min=0, Max=255, SampleTime=0.01)
Acceleration_Mode = Simulink.Signal(StorageClass="ExportToFile", HeaderFile="Adaptive_Cruise_Control.h", DefinitionFile="Adaptive_Cruise_Control.c", DataType="uint8", Min=0, Max=255, SampleTime=0.01)