% Simulink data dictionary minipro_sldd.sldd

CameraInput_RoadSign = Simulink.Signal(StorageClass="ImportedExtern", DataType="int16", Min=0, Max=1)
Vehicle_Turn_Status = Simulink.Signal(StorageClass="Localizable", DataType="int16", Min=-180, Max=180, Unit="deg")
Vehicle_Direction_Indicator = Simulink.Signal(StorageClass="ExportToFile", DataType="boolean", Min=0, Max=1)
Left_Turn_AngularLimit = Simulink.Parameter(-120, StorageClass="Const", DataType="int16", Min=-180, Max=180, Unit="deg")
Right_Turn_AngularLimit = Simulink.Parameter(30, StorageClass="Const", DataType="int16", Min=-180, Max=180, Unit="deg")
Straight_Drive_Steering_Angle = Simulink.Parameter(0, StorageClass="Const", DataType="int16", Min=-180, Max=180, Unit="deg")
LeftTurn_RoadSign = Simulink.Parameter(-120, StorageClass="Const", DataType="int16", Min=-180, Max=180)
RightTurn_RoadSign = Simulink.Parameter(30, StorageClass="Const", DataType="int16", Min=-180, Max=180)
Straight_RoadSign = Simulink.Parameter(0, StorageClass="Const", DataType="int16", Min=-180, Max=180)
SteeringWheel_YawDegreeInput = Simulink.Signal(StorageClass="ImportedExtern", DataType="int16", Min=-180, Max=180, Unit="deg")